# Grasshopper definition assembled_speckle.gh (Grasshopper 1.0.7)
# plug-ins: eleFront, Speckle 2, treesloth01, Human, Pufferfish

# ----
# filter terrain
# add actual units
panel = Panel("Contours")
reflay = ReferenceByLayer(LayerName=panel, lightweight=False)
reflay_2 = ReferenceByLayer(LayerName="TopoBrep", lightweight=False)
reflay_3 = ReferenceByLayer(LayerName="TopoMesh", lightweight=False)
reflay_4 = ReferenceByLayer(LayerName="BakedStudioMarsTopoMain", lightweight=False)
list = ValueList({"AngularDimension", "Arc", "Block", "Brep", "Circle", "Curve", "Dimension", "Ellipse", "Extrusion", "Hatch", "Leader", "Line", "LinearDimension", "Mesh", "Point", "Polyline", "Polysurface", "RadialDimension", "Surface", "Text", "TextDot"}, selected="Mesh")
panel_2 = Panel(reflay)
panel_3 = Panel(reflay_2)
panel_4 = Panel(reflay_3)
panel_5 = Panel(reflay_4)
filtertype = FilterByType(ObjectType=list, Geometry=reflay_4, invertFilter=False, returnNulls=False)  # -> ExcludedGeometry, IncludedGeometry
mesh = MeshBrep(
    Brep=reflay_2,
    Settings={GridMaxCount=0, GridMinCount=16, JaggedSeams=False, MaxEdgeLength=0, MinEdgeLength=0.0001, MinTolerance=0, Refine=True, RefineAngle=0, RelativeTolerance=0.65, SimplePlanes=True, Tolerance=0})
brep = Brep(reflay_2)
mesh_2 = Mesh(reflay_3)
mesh_3 = Mesh(filtertype.IncludedGeometry)
faceb = FaceBoundaries(Mesh=mesh_3)
faceb_2 = FaceBoundaries(Mesh=mesh_2)
boundary = BoundarySurfaces(Edges=faceb)
boundary_2 = BoundarySurfaces(Edges=faceb_2)
join = BrepJoin(Breps=boundary)  # -> Breps, Closed
mesh_4 = Mesh(filtertype.IncludedGeometry)
# TERRAIN
join_2 = BrepJoin(Breps=boundary_2)  # -> Breps, Closed
mesh_5 = Mesh(reflay_3)

# ---- group: BIMSC-PROJECT
# Send a message to James M. to add
# new materials. This list will be updated
# for all groups to have a common material
# library and common material names.
panel_6 = Panel("ELEMENTAL MARS")
bimsc_project = Text(panel_6)

# ---- group: FLOOR_LEVELS
# Set your 'Project' name, your 'Group'
# number, your 'Volume' Location that
# connect wirelessly.
series = Series(Start=0, Step=1, Count="5")
expression = Expression(x=series, Expression="Format(\"{0:00}\", x)")
concat = Concatenate(FragmentA="L", FragmentB=expression)  # -> simplify(graft(Result))
floor_levels = Text(concat)

# ---- group: RECEIVE MATERIALS
# RECIEVE
# MATERIALS
panel_7 = Panel("https://macad.speckle.xyz/streams/4975f9f0a8/branches/site%2F05-materials")
receive = Receive(
    Stream=panel_7,
    AutoReceive=False,
    CurrentComponentState="expired",
    ExpandOutput=True,
    LastInfoMessage="James McBennett @ 03/02/2024 01:57:29: Materials 01-03-2024 (id:6ecf38526e)",
    ReceiveOnOpen=False,
    ReceivedCommitId="6ecf38526e",
    StreamWrapper="https://macad.speckle.xyz/streams/4975f9f0a8/branches/site/05-materials",
    selectedKitName="Objects")  # -> Info, Materials
dso = DeconstructSpeckleObject(SpeckleObject=receive.Materials, selectedKitName="Objects")  # -> Inflatable, Soil, Steel

# ----
reflay_5 = ReferenceByLayer(LayerName="UnitsRawVolumes", lightweight=False)

# ----
# UNITS
volume = Volume(Geometry=reflay_5)  # -> Volume, Centroid
int = Integer(volume.Volume)
cset = CreateSet(List=int)  # -> Set, Map
cset_2 = CreateSet(List=cset.Map)  # -> Set, Map
mindex = MemberIndex(Set=cset.Map, Member=cset_2.Set)  # -> Index, Count
item = ListItem(List=reflay_5, Index=mindex.Index, Wrap=True)  # -> simplify(Item)
bang = ExplodeTree(Data=item)  # -> Branch0, Branch1

# ---- group: BIMSC-ORIGINATOR
bimsc_originator = Text("G06")

# ---- group: WorksForBrepsAndMeshes
list_2 = ValueList({"Srf/Brep": 0, "Mesh": 1}, selected="Mesh")

# ---- group: BIMSC-VOLUME
bimsc_volume = Text("A4")

# ----
area = Area(Geometry=bang.Branch1)  # -> Area, Centroid
prox = Proximity3D(Points=area.Centroid, Group="1", MaxRadius="5")  # -> simplify(Links), Topology
clean = CleanTree(RemoveNulls=True, RemoveInvalid=True, RemoveEmpty=True, Tree=prox.Links)
tstat = TreeStatistics(Tree=clean)  # -> Paths, Length, Count
split = SplitTree(Data=simplify(graft(bang.Branch1)), Masks=flatten(tstat.Paths))  # -> flatten(Positive), flatten(Negative)

item_2 = ListItem(List=bang.Branch0, Index=0, Wrap=True)
item_3 = ListItem(List=split.Negative, Index=0, Wrap=True)

# ----
# ROOFS
panel_8 = Panel("Roof")
reflay_6 = ReferenceByLayer(LayerName=panel_8, lightweight=False, DisableAutoUpdate=False)
panel_9 = Panel(reflay_6)
mesh_6 = Mesh(reflay_6)
faceb_3 = FaceBoundaries(Mesh=mesh_6)
boundary_3 = BoundarySurfaces(Edges=faceb_3)
join_3 = BrepJoin(Breps=boundary_3)  # -> Breps, Closed
mesh_7 = Mesh(reflay_6)

# ----
# WALLS
panel_10 = Panel("Wall")
reflay_7 = ReferenceByLayer(LayerName=panel_10, lightweight=False, DisableAutoUpdate=False)
panel_11 = Panel(reflay_7)
mesh_8 = MeshBrep(
    Brep=reflay_7,
    Settings={GridMaxCount=0, GridMinCount=16, JaggedSeams=False, MaxEdgeLength=0, MinEdgeLength=0.0001, MinTolerance=0, Refine=True, RefineAngle=0, RelativeTolerance=0.65, SimplePlanes=True, Tolerance=0})
brep_2 = Brep(reflay_7)
mjoin = MeshJoin(Meshes=mesh_8)
weld = WeldMesh(Mesh=mjoin, Angle=3.141592654)

# ----
# FLOORS
panel_12 = Panel("Pods")
reflay_8 = ReferenceByLayer(LayerName=panel_12, lightweight=False, DisableAutoUpdate=False)
panel_13 = Panel(reflay_8)
mesh_9 = MeshBrep(
    Brep=reflay_8,
    Settings={GridMaxCount=0, GridMinCount=16, JaggedSeams=False, MaxEdgeLength=0, MinEdgeLength=0.0001, MinTolerance=0, Refine=True, RefineAngle=0, RelativeTolerance=0.65, SimplePlanes=True, Tolerance=0})
brep_3 = Brep(reflay_8)
mjoin_2 = MeshJoin(Meshes=mesh_9)
weld_2 = WeldMesh(Mesh=mjoin_2, Angle=3.141592654)

reflay_9 = ReferenceByLayer(LayerName="Floors", lightweight=False, DisableAutoUpdate=False)
panel_14 = Panel(reflay_9)
mesh_10 = MeshBrep(
    Brep=reflay_9,
    Settings={GridMaxCount=0, GridMinCount=16, JaggedSeams=False, MaxEdgeLength=0, MinEdgeLength=0.0001, MinTolerance=0, Refine=True, RefineAngle=0, RelativeTolerance=0.65, SimplePlanes=True, Tolerance=0})
brep_4 = Brep(reflay_9)
mjoin_3 = MeshJoin(Meshes=mesh_10)
weld_3 = WeldMesh(Mesh=mjoin_3, Angle=3.141592654)

# ----
# UNITS
panel_15 = Panel("UnitsRawVolumes")
reflay_10 = ReferenceByLayer(LayerName=panel_15, lightweight=False, DisableAutoUpdate=False)
panel_16 = Panel(reflay_10)
mesh_11 = MeshBrep(
    Brep=reflay_10,
    Settings={GridMaxCount=0, GridMinCount=16, JaggedSeams=False, MaxEdgeLength=0, MinEdgeLength=0.0001, MinTolerance=0, Refine=True, RefineAngle=0, RelativeTolerance=0.65, SimplePlanes=True, Tolerance=0})
brep_5 = Brep(reflay_10)
mjoin_4 = MeshJoin(Meshes=mesh_11)
weld_4 = WeldMesh(Mesh=mjoin_4, Angle=3.141592654)

reflay_11 = ReferenceByLayer(LayerName="UnitsFloors", lightweight=False, DisableAutoUpdate=False)
panel_17 = Panel(reflay_11)
mesh_12 = MeshBrep(
    Brep=reflay_11,
    Settings={GridMaxCount=0, GridMinCount=16, JaggedSeams=False, MaxEdgeLength=0, MinEdgeLength=0.0001, MinTolerance=0, Refine=True, RefineAngle=0, RelativeTolerance=0.65, SimplePlanes=True, Tolerance=0})
brep_6 = Brep(reflay_11)
mjoin_5 = MeshJoin(Meshes=mesh_12)
weld_5 = WeldMesh(Mesh=mjoin_5, Angle=3.141592654)

reflay_12 = ReferenceByLayer(LayerName="UnitsFabricMesh", lightweight=False, DisableAutoUpdate=False)
reflay_13 = ReferenceByLayer(LayerName="UnitsFabricSrf", lightweight=False, DisableAutoUpdate=False)
panel_18 = Panel([reflay_12, reflay_13])

renumber = RenumberPaths(Data=clean)
end = EndPoints(Curve=renumber)  # -> Start, End
pdecon = Deconstruct(Point=[end.Start, end.End])  # -> XComponent, YComponent, ZComponent
int_2 = Integer(pdecon.ZComponent)
bnd = Bounds(Numbers=int_2)
dedomain = DeconstructDomain(Domain=bnd)  # -> Start, End
equals = Equality(FirstNumber=int_2, SecondNumber=dedomain.Start)  # -> Equality, Inequality
subtraction = Subtraction(A=dedomain.Start, B=dedomain.End)
cull = CullPattern(List=[end.Start, end.End], CullPattern=equals.Equality)
division = Division(A=subtraction, B="2")
abs = Absolute(Value=subtraction)
Z = UnitZ(Factor=division)
wires = BrepWireframe(Brep=split.Positive, Density=-1)
move = Move(Geometry=cull, Motion=Z)  # -> Geometry, Transform
project = Project(Geometry=wires, Plane=move.Geometry)  # -> simplify(Geometry), Transform

end_2 = EndPoints(Curve=project.Geometry)  # -> Start, End
multiplication = Multiplication(A=abs, B="2")
cullpt = CullDuplicates(Points=[end_2.Start, end_2.End], Tolerance=0.1, CullMode=3)  # -> Points, Indices, Valence
pline = PolyLine(Vertices=cullpt.Points, Closed=True)  # -> simplify(Polyline)
Z_2 = UnitZ(Factor=multiplication)
extr = Extrude(Base=pline, Direction=Z_2)
cap = CapHoles(Brep=extr)

relay = Relay()
relay_2 = Relay()
srf = Surface(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)  # disabled

# ---- group: PHASE
num = Number(Tree({0}: [1], {1}: [1], {2}: [2], {3}: [2], {4}: [3]))

# ---- group: LEVEL
floor_levels_2 = Text(floor_levels)

# ----
filter = StreamFilter(Gate=list_2, Stream0=reflay_13, Stream1=reflay_12)
name = ExtendSpeckleObject(
    SpeckleObject=filter,
    BIMSCPROJECT=bimsc_project,
    BIMSCORIGINATOR=bimsc_originator,
    BIMSCVOLUME=bimsc_volume,
    BIMSCLEVEL=floor_levels_2,
    BIMSCTYPE="TERRAIN",
    BIMSCMATERIAL="soil",
    RenderMaterial=dso.Soil,
    BIMSCPHASE=num,
    selectedKitName="Objects")  # -> flatten(ExtendedSpeckleObject)

# ---- group: PHASE
num_2 = Number(Tree({0}: [1], {1}: [1], {2}: [2], {3}: [2], {4}: [3]))

# ---- group: LEVEL
floor_levels_3 = Text(floor_levels)

# ----
filter_2 = StreamFilter(Gate=list_2, Stream0=brep_6, Stream1=weld_5)
name_2 = ExtendSpeckleObject(
    SpeckleObject=filter_2,
    BIMSCPROJECT=bimsc_project,
    BIMSCORIGINATOR=bimsc_originator,
    BIMSCVOLUME=bimsc_volume,
    BIMSCLEVEL=floor_levels_3,
    BIMSCTYPE="FLOORS UNITS",
    BIMSCMATERIAL="steel",
    RenderMaterial=relay,
    BIMSCPHASE=num_2,
    selectedKitName="Objects")  # -> flatten(ExtendedSpeckleObject)

# ---- group: PHASE
num_3 = Number(Tree({0}: [1], {1}: [1], {2}: [2], {3}: [2], {4}: [3]))

# ---- group: LEVEL
floor_levels_4 = Text(floor_levels)

# ----
filter_3 = StreamFilter(Gate=list_2, Stream0=brep_5, Stream1=weld_4)
name_3 = ExtendSpeckleObject(
    SpeckleObject=filter_3,
    BIMSCPROJECT=bimsc_project,
    BIMSCORIGINATOR=bimsc_originator,
    BIMSCVOLUME=bimsc_volume,
    BIMSCLEVEL=floor_levels_4,
    BIMSCTYPE="UNIT WALLS",
    BIMSCMATERIAL="Inflatable",
    RenderMaterial=relay_2,
    BIMSCPHASE=num_3,
    selectedKitName="Objects")  # -> flatten(ExtendedSpeckleObject)

# ---- group: PHASE
num_4 = Number(Tree({0}: [1], {1}: [1], {2}: [2], {3}: [2], {4}: [3]))

# ---- group: LEVEL
floor_levels_5 = Text(floor_levels)

# ----
filter_4 = StreamFilter(Gate=list_2, Stream0=brep_4, Stream1=weld_3)
name_4 = ExtendSpeckleObject(
    SpeckleObject=filter_4,
    BIMSCPROJECT=bimsc_project,
    BIMSCORIGINATOR=bimsc_originator,
    BIMSCVOLUME=bimsc_volume,
    BIMSCLEVEL=floor_levels_5,
    BIMSCTYPE="FLOORS",
    BIMSCMATERIAL="Regolith",
    RenderMaterial=dso.Steel,
    BIMSCPHASE=num_4,
    selectedKitName="Objects")  # -> flatten(ExtendedSpeckleObject)

# ---- group: PHASE
num_5 = Number(Slider(3, range=1..3))

# ---- group: LEVEL
floor_levels_6 = Text(floor_levels)

# ----
filter_5 = StreamFilter(Gate=list_2, Stream0=brep_3, Stream1=weld_2)
name_5 = ExtendSpeckleObject(
    SpeckleObject=filter_5,
    BIMSCPROJECT=bimsc_project,
    BIMSCORIGINATOR=bimsc_originator,
    BIMSCVOLUME=bimsc_volume,
    BIMSCLEVEL=floor_levels_6,
    BIMSCTYPE="PODS",
    BIMSCMATERIAL="Regolith",
    RenderMaterial=dso.Steel,
    BIMSCPHASE=num_5,
    selectedKitName="Objects")  # -> flatten(ExtendedSpeckleObject)

# ---- group: LEVEL
txt = Text(Tree({0}: ["L00"], {1}: ["L04"]))

# ---- group: PHASE
num_6 = Number(Tree({0}: [1], {1}: [3]))

# ----
filter_6 = StreamFilter(Gate=list_2, Stream0=brep_2, Stream1=weld)  # -> reverse(simplify(graft(Stream)))
name_6 = ExtendSpeckleObject(
    SpeckleObject=filter_6,
    BIMSCPROJECT=bimsc_project,
    BIMSCORIGINATOR=bimsc_originator,
    BIMSCVOLUME=bimsc_volume,
    BIMSCLEVEL=txt,
    BIMSCTYPE="WALLS",
    BIMSCMATERIAL="REGOLITH",
    RenderMaterial=dso.Soil,
    BIMSCPHASE=num_6,
    selectedKitName="Objects")

# ---- group: LEVEL
txt_2 = Text(Tree({0}: ["L00"], {1}: ["L04"]))

# ---- group: PHASE
num_7 = Number(Tree({0}: [1], {1}: [3]))

# ----
filter_7 = StreamFilter(Gate=list_2, Stream0=join_3.Breps, Stream1=mesh_7)  # -> reverse(simplify(graft(Stream)))
name_7 = ExtendSpeckleObject(
    SpeckleObject=filter_7,
    BIMSCPROJECT=bimsc_project,
    BIMSCORIGINATOR=bimsc_originator,
    BIMSCVOLUME=bimsc_volume,
    BIMSCLEVEL=txt_2,
    BIMSCTYPE="ROOF",
    BIMSCMATERIAL="Inflatable",
    RenderMaterial=dso.Inflatable,
    BIMSCPHASE=num_7,
    selectedKitName="Objects")

panel_19 = Panel("100")  # disabled

panel_20 = Panel("https://macad.speckle.xyz/streams/4975f9f0a8/branches/site/04-community-site")  # disabled
number_slider = Slider(3, range=0..17)  # disabled
receive_2 = Receive(
    Stream=panel_20,
    AutoReceive=False,
    CurrentComponentState="expired",
    ExpandOutput=True,
    LastInfoMessage="James McBennett @ 03/01/2024 23:14:17: 2024 Mar-01 (id:9ec35295b2)",
    ReceiveOnOpen=False,
    ReceivedCommitId="9ec35295b2",
    StreamWrapper="https://macad.speckle.xyz/streams/4975f9f0a8/branches/site/04-community-site",
    selectedKitName="Objects")  # -> Info, CONTOURS, SOIL; disabled
# EDIT SITE MESH
item_4 = ListItem(List=flatten(receive_2.SOIL), Index=number_slider, Wrap=True)  # disabled
bbox = BoundingBox(Content=srf, Plane=PlaneXY(0, 0, 0))  # -> Box, Box_2; disabled
volume_2 = Volume(Geometry=bbox.Box)  # -> Volume, Centroid; disabled
panel_21 = Panel("30000")  # disabled
msphere = MeshSphere(Base=volume_2.Centroid, Radius=panel_21, UCount=panel_19, VCount=panel_19)  # disabled
msplit = MeshSplit(Mesh=item_4, Splitters=msphere)  # disabled

mmx = MeshMesh(MeshA=item_4, MeshB=msphere)  # disabled
panel_22 = Panel("https://macad.speckle.xyz/streams/5e4e4e4563/branches/24.02.27-class")  # disabled
cso = CreateSpeckleObject(
    ROOF=name_7,
    WALL=name_6,
    FLOORS=name_4,
    PODS=name_5,
    UNITS=name_3,
    UNITFLOORS=name_2,
    TERRAIN=name,
    selectedKitName="Objects")

# ----
# SEND
panel_23 = Panel("https://macad.speckle.xyz/streams/4975f9f0a8/branches/wip%2Fg06")
send = Send(
    Stream=panel_23,
    Message="Test",
    D=cso,
    AutoSend=False,
    BaseId="26703631f992334cb49fab06b5e3b2c5",
    CurrentComponentState="expired",
    KitName="Objects",
    OutputWrappers="https://macad.speckle.xyz\t4975f9f0a8\tb658242c57",
    UseDefaultCache=True,
    selectedKitName="Objects")

# ----
# g06 wip branch
# https://macad.speckle.xyz/streams/4975f9f0a8/branches/wip%2Fg06
# g06 shared branch
# https://macad.speckle.xyz/streams/4975f9f0a8/branches/shared%2Fg06
panel_24 = Panel(send)

number_slider_2 = Slider(1.5, range=1..2)
range = Range(Domain=Slider(1.5, range=0..6.002), Steps=number_slider_2)
range_2 = Range(Domain=Domain(0, 1), Steps=number_slider_2)
graph = GraphMapper(range_2, x0=0, x1=1, y0=0, y1=1, container_name="Bezier", cpx=[0, 0.5185281634, 1, 1], cpy=[0, 0, 0.1436586976, 1])
pt = ConstructPoint(XCoordinate=0, YCoordinate=0, ZCoordinate=range)
dom = ConstructDomain(DomainStart=Slider(2, range=1..13), DomainEnd=Slider(0.7, range=0..2.02))
bnd_2 = Bounds(Numbers=graph)
prot = RotatePlane(Plane=pt, Angle="0.5*pi")
remap = RemapNumbers(Value=graph, Source=bnd_2, Target=dom)  # -> Mapped, Clipped
cir = Circle(Plane=pt, Radius=remap.Mapped)
item_5 = ListItem(List=cir, Index=0, Wrap=True)
area_2 = Area(Geometry=item_5)  # -> Area, Centroid
number_slider_3 = Slider(0.01, range=0..1)
range_3 = Range(Domain=Domain(0, 1), Steps=Slider(4, range=0..50))
shatter = Shatter(Curve=reparameterize(graft(cir)), Parameters=range_3)
subtraction_2 = Subtraction(A="1", B=number_slider_3)
merge = Merge(Data1="0", Data2=number_slider_3, Data3=subtraction_2, Data4="1")
consec = ConsecutiveDomains(Numbers=merge, Additive=invert(True))
panel_25 = Panel(merge)
subcrv = SubCurve(BaseCurve=reparameterize(graft(shatter)), Domain=consec)
panel_26 = Panel("""0
2""")
panel_27 = Panel(consec)
cull_i = CullIndex(List=subcrv, Indices=panel_26, Wrap=True)  # -> simplify(List)
item_6 = ListItem(List=subcrv, Index=panel_26, Wrap=True)
pshift = ShiftPaths(Data=cull_i, Offset=-1)
flip = FlipMatrix(Data=pshift)
midpt = CurveMiddle(Curve=flip)
loft = Loft(Curves=cir, Options={Adjust=False, Closed=False, LoftEnds=0, LoftSimp=0, LoftType=0, Rebuild=10, Refit=0.01})
pshift_2 = ShiftPaths(Data=item_6, Offset=-1)
graph_2 = GraphMapper(range_2, x0=0, x1=1, y0=0, y1=1, container_name="Bezier", cpx=[0, 0.25, 0.75, 1], cpy=[0, 0.25, 0.75, 1])
join_4 = JoinCurves(Curves=pshift_2, Preserve=False)
brep_cp = BrepClosestPoint(Point=midpt, Brep=loft)  # -> Point, Normal, Distance
dom_2 = ConstructDomain(DomainStart=Slider(0.1, range=0..10), DomainEnd=Slider(0.11, range=0..1))
flip_2 = FlipMatrix(Data=join_4)
bnd_3 = Bounds(Numbers=graph_2)
remap_2 = RemapNumbers(Value=graph_2, Source=bnd_3, Target=dom_2)  # -> Mapped, Clipped
amp = Amplitude(Vector=brep_cp.Normal, Amplitude=remap_2.Mapped)
rev = Reverse(Vector=amp)
end_3 = EndPoints(Curve=flip)  # -> Start, End
move_2 = Move(Geometry=midpt, Motion=rev)  # -> Geometry, Transform
arc = Arc3Pt(PointA=end_3.Start, PointB=move_2.Geometry, PointC=end_3.End)  # -> Arc, Plane, Radius
item_7 = ListItem(List=arc.Arc, Index=0, Wrap=True)
project_2 = Project(Geometry=item_7, Plane=PlaneXY(0, 0, 0))  # -> Geometry, Transform
loft_opt = LoftOptions(Closed=False, Adjust=False, Rebuild=0, Refit="0.01", Type=0)
replace = ReplaceItems(List=arc.Arc, Item=project_2.Geometry, Indices="0", Wrap=False)
loft_2 = Loft(Curves=flip_2, Options=loft_opt)
loft_3 = Loft(Curves=replace, Options=loft_opt)
entwine = Entwine(Branch00=loft_3, Branch01=loft_2, FlattenInputs=True)
brep_7 = Brep(item_2)
merge_2 = Merge(Data1=ColourSwatch(SwatchColor=RGBA(107, 107, 107, 206)), Data2=ColourSwatch(SwatchColor=RGB(255, 255, 255)))  # -> simplify(graft(Result))
python = GhPythonScript(S=entwine, D=Slider(0.01, range=0..1))  # -> simplify(a); inputs S: Brep
# ---------- python: Python ----------
import rhinoscriptsyntax as rs

a = rs.OffsetSurface(S, D, None, False, True)
# ---------- end python ----------
flatten = FlattenTree(Tree=python, Path="{0}")

Z_3 = UnitZ(Factor=expr("-x", Slider(0.1, range=0..10)))
item_8 = ListItem(List=cir, Index="-1", Wrap=True)
extr_2 = Extrude(Base=item_8, Direction=Z_3)
cap_2 = CapHoles(Brep=extr_2)

item_9 = ListItem(List=brep_7, Index=0, Wrap=True)

number_slider_4 = Slider(1.5, range=1..2)
range_4 = Range(Domain=Slider(3.7, range=0..6.002), Steps=number_slider_4)
range_5 = Range(Domain=Domain(0, 1), Steps=number_slider_4)
graph_3 = GraphMapper(range_5, x0=0, x1=1, y0=0, y1=1, container_name="Bezier", cpx=[0, 0.5185281634, 1, 1], cpy=[0, 0, 0.1436586976, 1])
pt_2 = ConstructPoint(XCoordinate=0, YCoordinate=0, ZCoordinate=range_4)
dom_3 = ConstructDomain(DomainStart=Slider(4.2, range=1..13), DomainEnd=Slider(1.2, range=0..2.02))
bnd_4 = Bounds(Numbers=graph_3)
prot_2 = RotatePlane(Plane=pt_2, Angle="0.5*pi")
remap_3 = RemapNumbers(Value=graph_3, Source=bnd_4, Target=dom_3)  # -> Mapped, Clipped
cir_2 = Circle(Plane=prot_2, Radius=remap_3.Mapped)
item_10 = ListItem(List=cir_2, Index=0, Wrap=True)
area_3 = Area(Geometry=item_10)  # -> Area, Centroid
number_slider_5 = Slider(0.01, range=0..1)
range_6 = Range(Domain=Domain(0, 1), Steps=Slider(8, range=0..50))
shatter_2 = Shatter(Curve=reparameterize(graft(cir_2)), Parameters=range_6)
subtraction_3 = Subtraction(A="1", B=number_slider_5)
merge_3 = Merge(Data1="0", Data2=number_slider_5, Data3=subtraction_3, Data4="1")
consec_2 = ConsecutiveDomains(Numbers=merge_3, Additive=invert(True))
panel_28 = Panel(merge_3)
subcrv_2 = SubCurve(BaseCurve=reparameterize(graft(shatter_2)), Domain=consec_2)
panel_29 = Panel("""0
2""")
panel_30 = Panel(consec_2)
cull_i_2 = CullIndex(List=subcrv_2, Indices=panel_29, Wrap=True)  # -> simplify(List)
item_11 = ListItem(List=subcrv_2, Index=panel_29, Wrap=True)
pshift_3 = ShiftPaths(Data=cull_i_2, Offset=-1)
flip_3 = FlipMatrix(Data=pshift_3)
midpt_2 = CurveMiddle(Curve=flip_3)
loft_4 = Loft(Curves=cir_2, Options={Adjust=False, Closed=False, LoftEnds=0, LoftSimp=0, LoftType=0, Rebuild=10, Refit=0.01})
pshift_4 = ShiftPaths(Data=item_11, Offset=-1)
graph_4 = GraphMapper(range_5, x0=0, x1=1, y0=0, y1=1, container_name="Bezier", cpx=[0, 0.25, 0.75, 1], cpy=[0, 0.25, 0.75, 1])
join_5 = JoinCurves(Curves=pshift_4, Preserve=False)
brep_cp_2 = BrepClosestPoint(Point=midpt_2, Brep=loft_4)  # -> Point, Normal, Distance
dom_4 = ConstructDomain(DomainStart=Slider(0.1, range=0..10), DomainEnd=Slider(0.11, range=0..1))
flip_4 = FlipMatrix(Data=join_5)
bnd_5 = Bounds(Numbers=graph_4)
remap_4 = RemapNumbers(Value=graph_4, Source=bnd_5, Target=dom_4)  # -> Mapped, Clipped
amp_2 = Amplitude(Vector=brep_cp_2.Normal, Amplitude=remap_4.Mapped)
rev_2 = Reverse(Vector=amp_2)
end_4 = EndPoints(Curve=flip_3)  # -> Start, End
move_3 = Move(Geometry=midpt_2, Motion=rev_2)  # -> Geometry, Transform
arc_2 = Arc3Pt(PointA=end_4.Start, PointB=move_3.Geometry, PointC=end_4.End)  # -> Arc, Plane, Radius
item_12 = ListItem(List=arc_2.Arc, Index=0, Wrap=True)
project_3 = Project(Geometry=item_12, Plane=PlaneXY(0, 0, 0))  # -> Geometry, Transform
loft_opt_2 = LoftOptions(Closed=False, Adjust=False, Rebuild=0, Refit="0.01", Type=0)
replace_2 = ReplaceItems(List=arc_2.Arc, Item=project_3.Geometry, Indices="0", Wrap=False)
loft_5 = Loft(Curves=flip_4, Options=loft_opt_2)
loft_6 = Loft(Curves=replace_2, Options=loft_opt_2)
entwine_2 = Entwine(Branch00=loft_6, Branch01=loft_5, FlattenInputs=True)
merge_4 = Merge(Data1=ColourSwatch(SwatchColor=RGBA(107, 107, 107, 206)), Data2=ColourSwatch(SwatchColor=RGB(255, 255, 255)))  # -> simplify(graft(Result))
python_2 = GhPythonScript(S=entwine_2, D=Slider(0.01, range=0..1))  # -> simplify(a); inputs S: Brep; same code as python
brep_8 = Brep(cap)
flatten_2 = FlattenTree(Tree=python_2, Path="{0}")

Z_4 = UnitZ(Factor=expr("-x", Slider(0.1, range=0..10)))
item_13 = ListItem(List=cir_2, Index="-1", Wrap=True)
extr_3 = Extrude(Base=item_13, Direction=Z_4)
cap_3 = CapHoles(Brep=extr_3)

item_14 = ListItem(List=flatten(brep_8), Index=0, Wrap=True)

number_slider_6 = Slider(1.5, range=1..2)
range_7 = Range(Domain=Slider(1.5, range=0..6.002), Steps=number_slider_6)
range_8 = Range(Domain=Domain(0, 1), Steps=number_slider_6)
graph_5 = GraphMapper(range_8, x0=0, x1=1, y0=0, y1=1, container_name="Bezier", cpx=[0, 0.5185281634, 1, 1], cpy=[0, 0, 0.1436586976, 1])
pt_3 = ConstructPoint(XCoordinate=0, YCoordinate=0, ZCoordinate=range_7)
dom_5 = ConstructDomain(DomainStart=Slider(3.9, range=1..13), DomainEnd=Slider(1.2, range=0..2.02))
bnd_6 = Bounds(Numbers=graph_5)
prot_3 = RotatePlane(Plane=pt_3, Angle="0.5*pi")
remap_5 = RemapNumbers(Value=graph_5, Source=bnd_6, Target=dom_5)  # -> Mapped, Clipped
number_slider_7 = Slider(0.01, range=0..1)
cir_3 = Circle(Plane=prot_3, Radius=remap_5.Mapped)
item_15 = ListItem(List=cir_3, Index=0, Wrap=True)
area_4 = Area(Geometry=item_15)  # -> Area, Centroid
subtraction_4 = Subtraction(A="1", B=number_slider_7)
range_9 = Range(Domain=Domain(0, 1), Steps=Slider(8, range=0..50))
merge_5 = Merge(Data1="0", Data2=number_slider_7, Data3=subtraction_4, Data4="1")
shatter_3 = Shatter(Curve=reparameterize(graft(cir_3)), Parameters=range_9)
consec_3 = ConsecutiveDomains(Numbers=merge_5, Additive=invert(True))
panel_31 = Panel(merge_5)
subcrv_3 = SubCurve(BaseCurve=reparameterize(graft(shatter_3)), Domain=consec_3)
panel_32 = Panel("""0
2""")
panel_33 = Panel(consec_3)
cull_i_3 = CullIndex(List=subcrv_3, Indices=panel_32, Wrap=True)  # -> simplify(List)
item_16 = ListItem(List=subcrv_3, Index=panel_32, Wrap=True)
pshift_5 = ShiftPaths(Data=cull_i_3, Offset=-1)
flip_5 = FlipMatrix(Data=pshift_5)
midpt_3 = CurveMiddle(Curve=flip_5)
loft_7 = Loft(Curves=cir_3, Options={Adjust=False, Closed=False, LoftEnds=0, LoftSimp=0, LoftType=0, Rebuild=10, Refit=0.01})
pshift_6 = ShiftPaths(Data=item_16, Offset=-1)
graph_6 = GraphMapper(range_8, x0=0, x1=1, y0=0, y1=1, container_name="Bezier", cpx=[0, 0.25, 0.75, 1], cpy=[0, 0.25, 0.75, 1])
join_6 = JoinCurves(Curves=pshift_6, Preserve=False)
brep_cp_3 = BrepClosestPoint(Point=midpt_3, Brep=loft_7)  # -> Point, Normal, Distance
dom_6 = ConstructDomain(DomainStart=Slider(0.1, range=0..10), DomainEnd=Slider(0.11, range=0..1))
flip_6 = FlipMatrix(Data=join_6)
bnd_7 = Bounds(Numbers=graph_6)
remap_6 = RemapNumbers(Value=graph_6, Source=bnd_7, Target=dom_6)  # -> Mapped, Clipped
amp_3 = Amplitude(Vector=brep_cp_3.Normal, Amplitude=remap_6.Mapped)
rev_3 = Reverse(Vector=amp_3)
end_5 = EndPoints(Curve=flip_5)  # -> Start, End
move_4 = Move(Geometry=midpt_3, Motion=rev_3)  # -> Geometry, Transform
arc_3 = Arc3Pt(PointA=end_5.Start, PointB=move_4.Geometry, PointC=end_5.End)  # -> Arc, Plane, Radius
item_17 = ListItem(List=arc_3.Arc, Index=0, Wrap=True)
project_4 = Project(Geometry=item_17, Plane=PlaneXY(0, 0, 0))  # -> Geometry, Transform
loft_opt_3 = LoftOptions(Closed=False, Adjust=False, Rebuild=0, Refit="0.01", Type=0)
replace_3 = ReplaceItems(List=arc_3.Arc, Item=project_4.Geometry, Indices="0", Wrap=False)
loft_8 = Loft(Curves=flip_6, Options=loft_opt_3)
loft_9 = Loft(Curves=replace_3, Options=loft_opt_3)
entwine_3 = Entwine(Branch00=loft_9, Branch01=loft_8, FlattenInputs=True)
merge_6 = Merge(Data1=ColourSwatch(SwatchColor=RGBA(189, 189, 189, 206)), Data2=ColourSwatch(SwatchColor=RGB(255, 255, 255)))  # -> simplify(graft(Result))
python_3 = GhPythonScript(S=entwine_3, D=Slider(0.01, range=0..1))  # -> simplify(a); inputs S: Brep; same code as python
brep_9 = Brep(item_3)
volume_3 = Volume(Geometry=brep_9)  # -> Volume, Centroid
flatten_3 = FlattenTree(Tree=python_3, Path="{0}")
move2pt = MoveToPoint(Geometry=flatten_3, PointA=area_4.Centroid, PointB=graft(volume_3.Centroid))  # -> simplify(Moved), Vector, Transform
lng = ListLength(List=move2pt.Moved)
graft = GraftTree(Tree=volume_3.Centroid, IncludeEmptyLists=True, IncludeNullItems=True)  # -> simplify(Tree)
group = Group(Objects=move2pt.Moved)
split_2 = SplitList(List=move2pt.Moved, Index=expr("x/2", lng))  # -> flatten(ListA), flatten(ListB)
mirror = Mirror(Geometry=group, Plane=graft)  # -> Geometry, Transform
ungroup = Ungroup(Group=mirror.Geometry)
entwine_4 = Entwine(Branch00=split_2.ListA, Branch01=split_2.ListB, FlattenInputs=True)  # -> simplify(Result)
split_3 = SplitList(List=ungroup, Index=expr("x/2", lng))  # -> flatten(ListA), flatten(ListB)
entwine_5 = Entwine(Branch00=split_3.ListA, Branch01=split_3.ListB, FlattenInputs=True)  # -> simplify(Result)
merge_7 = Merge(Data1=entwine_4, Data2=entwine_5)

Z_5 = UnitZ(Factor=expr("-x", Slider(0.1, range=0..10)))
item_18 = ListItem(List=cir_3, Index="-1", Wrap=True)
extr_4 = Extrude(Base=item_18, Direction=Z_5)
cap_4 = CapHoles(Brep=extr_4)

volume_4 = Volume(Geometry=item_9)  # -> Volume, Centroid
move2pt_2 = MoveToPoint(Geometry=flatten, PointA=area_2.Centroid, PointB=graft(volume_4.Centroid))  # -> simplify(Moved), Vector, Transform
lng_2 = ListLength(List=move2pt_2.Moved)
graft_2 = GraftTree(Tree=volume_4.Centroid, IncludeEmptyLists=True, IncludeNullItems=True)  # -> simplify(Tree)
group_2 = Group(Objects=move2pt_2.Moved)
split_4 = SplitList(List=move2pt_2.Moved, Index=expr("x/2", lng_2))  # -> flatten(ListA), flatten(ListB)
mirror_2 = Mirror(Geometry=group_2, Plane=graft_2)  # -> Geometry, Transform
ungroup_2 = Ungroup(Group=mirror_2.Geometry)
move2pt_3 = MoveToPoint(Geometry=cap_2, PointA=area_2.Centroid, PointB=graft(volume_4.Centroid))  # -> Moved, Vector, Transform
entwine_6 = Entwine(Branch00=split_4.ListA, Branch01=split_4.ListB, FlattenInputs=True)  # -> simplify(Result)
split_5 = SplitList(List=ungroup_2, Index=expr("x/2", lng_2))  # -> flatten(ListA), flatten(ListB)
entwine_7 = Entwine(Branch00=split_5.ListA, Branch01=split_5.ListB, FlattenInputs=True)  # -> simplify(Result)
merge_8 = Merge(Data1=entwine_6, Data2=entwine_7)
previewmat = CustomPreviewMaterials(Geometry=merge_8, DiffuseColor=merge_6)
previewmat_2 = CustomPreviewMaterials(Geometry=move2pt_3.Moved, DiffuseColor=RGB(255, 255, 255))

volume_5 = Volume(Geometry=item_14)  # -> Volume, Centroid
move2pt_4 = MoveToPoint(Geometry=flatten_2, PointA=area_3.Centroid, PointB=graft(volume_5.Centroid))  # -> simplify(Moved), Vector, Transform
lng_3 = ListLength(List=move2pt_4.Moved)
graft_3 = GraftTree(Tree=volume_5.Centroid, IncludeEmptyLists=True, IncludeNullItems=True)  # -> simplify(Tree)
group_3 = Group(Objects=move2pt_4.Moved)
split_6 = SplitList(List=move2pt_4.Moved, Index=expr("x/2", lng_3))  # -> flatten(ListA), flatten(ListB)
mirror_3 = Mirror(Geometry=group_3, Plane=graft_3)  # -> Geometry, Transform
ungroup_3 = Ungroup(Group=mirror_3.Geometry)
move2pt_5 = MoveToPoint(Geometry=cap_3, PointA=area_3.Centroid, PointB=graft(volume_5.Centroid))  # -> Moved, Vector, Transform
entwine_8 = Entwine(Branch00=split_6.ListA, Branch01=split_6.ListB, FlattenInputs=True)  # -> simplify(Result)
split_7 = SplitList(List=ungroup_3, Index=expr("x/2", lng_3))  # -> flatten(ListA), flatten(ListB)
entwine_9 = Entwine(Branch00=split_7.ListA, Branch01=split_7.ListB, FlattenInputs=True)  # -> simplify(Result)
merge_9 = Merge(Data1=entwine_8, Data2=entwine_9)
previewmat_3 = CustomPreviewMaterials(Geometry=merge_9, DiffuseColor=merge_6)
previewmat_4 = CustomPreviewMaterials(Geometry=move2pt_5.Moved, DiffuseColor=RGB(255, 255, 255))

data = Data([split_2.ListB, split_3.ListB])
data_2 = Data([split_2.ListA, split_3.ListA])
stack = StackTrees(Data0=data_2, Data1=data, Reduce=True)

move2pt_6 = MoveToPoint(Geometry=cap_4, PointA=area_4.Centroid, PointB=graft(volume_3.Centroid))  # -> Moved, Vector, Transform
previewmat_5 = CustomPreviewMaterials(Geometry=move2pt_6.Moved, DiffuseColor=RGB(255, 255, 255))
previewmat_6 = CustomPreviewMaterials(Geometry=stack, DiffuseColor=merge_6)

group_4 = Group(Objects=stack)  # -> flatten(Group)
group_5 = Group(Objects=group_4)
merge_10 = Merge(Data1=move2pt_5.Moved, Data2=merge_9, Data3=move2pt_6.Moved, Data4=merge_7, Data5=move2pt_3.Moved, Data6=merge_8)  # disabled
send_2 = Send(
    Stream=panel_22,
    Data=merge_10,
    AutoSend=False,
    BaseId="7005cf4f04ba1d7dde6e5ba4a54a8704",
    CurrentComponentState="expired",
    KitName="Objects",
    OutputWrappers="https://macad.speckle.xyz\t5e4e4e4563\t1905a1a1a6",
    UseDefaultCache=True,
    selectedKitName="Objects")  # disabled
panel_34 = Panel(send_2)  # disabled
